# Grasshopper definition Example File.gh (Grasshopper 1.0.8)
# plug-ins: GH Excel Tools

add_headers = Panel("""Oliver
Isla
Noah
Amelia
Leo
Olivia
Henry
Mia
Theodore
Charlotte""")

# ---- group: Create Random Data
random = Random(Range=Domain(0, 1), Number=Slider(100, range=0..100), Seed=2)
partition = PartitionList(List=random, Size=Slider(10, range=0..10))
ins = InsertItems(List=partition, Item=graft(add_headers), Indices="0", Wrap=True)

# ----
cells_to_change_properties = Panel("""A1
B1
C1
D1
E1
F1
G1
H1
I1
J1""")

# ---- group: Read Excel
path = FilePath("C:\Users\AndreiSmolik\OneDrive - KILMORE GROUP PTY LTD\Desktop\temp\Excel\test.xlsx")
eread = ExcelRead(FILE=path)  # -> DATA, SHEETS
panel = Panel(eread.DATA)
panel_2 = Panel(eread.SHEETS)

# ----
emod = ExcelModify(
    CELLS=cells_to_change_properties,
    COLOUR=ColourSwatch(SwatchColor=RGB(135, 173, 255)),
    BORDER=invert(False),
    FONTSIZE=12,
    ALIGN=2)
path_2 = FilePath("C:\Users\AndreiSmolik\OneDrive - KILMORE GROUP PTY LTD\Desktop\temp\Excel\")
esave = SaveExcel(PATH=path_2, NAME="test file", DATA=ins, MODIFY=emod, SHEET="Sheet1", SAVE=Button())
